vi "Main.Lab.gviweb"   [LabVIEW NXG 5.0.0]
panel controls:
  "Connecting Solar Panels": i32 = -1
  "Solar panel tilt angle, º": f64
  "Power setting for the light source, W": f64
  "Cooling conditions": i32 = -1
  "Clear/ Tab 1": bool
  "Isc": f64
  "Uoc": f64
  "Clear Graph Tab 4": bool
  "Save in memory": bool
  "Slot Name": string
  "Slot Number": i32 = "Slot 1"(0)
  "Imp": f64
  "Ump": f64
  "FF/Calculation": bool
  "Add to table Tab 4": bool
  "Calculate Tab 1": bool
  "T1": f64
  "T2": f64
  "Uoc/Calculation_3": f64
  "Uoc2": f64
  "Kt/Calculation": bool
  "Dimming conditions": i32 = -1
  "Parallel connection": i32 = -1
  "Series connection": i32 = -1
  "Heating conditions": i32 = -1
  "1х, Ohm": i32[]
  "10х": i32[]
  "100х": i32[]
  "Set Load": bool
  "Calculate average": bool
  "Parameter Y": i32 = -1
  "Parameter X": i32 = -1
  "Calculation": i32
  "1000х": i32[]
  "History Graph V/Measurment": i16 = 400
  "History Graph I/Measurment": i16 = 400
  "History Graph T/Measurment": i16 = 400
  "Clear All Memory": bool
  "Clear Table Tab 4": bool
  "Slot number/Read/": i32 = "1"(0)
  "Manual/Automatic": enum{"Manual", "Automatic"} = "Manual"
  "Show Graph Tab 4": bool
  "Clear Memory": bool
  "Slot number Tab 1": i32 = "1"(0)
  "Calc/Slot number2.1": i32 = "1"(0)
  "Show / Hide Graph 1": bool
  "Delete Last Tab 4": bool
  "Change History J/Measurment": i32
  "History Graph R/Measurment": i16 = 400
  "History Graph J/Measurment": i16 = 400
  "Show / Hide Graph 2": bool
  "Calc/Slot number2.2": i32 = "1"(0)
  "Calc/Slot number2.3": i32 = "1"(0)
  "Calc/Slot number2.4": i32 = "1"(0)
  "Show / Hide Graph 3": bool
  "Show / Hide Graph 4": bool
  "Input Data": f64[][] = [[1.814, 0.0233, 27.1, 0, 500, 70], [1.802, 0.069, 26.11, 0, 500, 75], [1.794, 0.109, 16.45, 0, 500, 73], [1.792, 0.151, 11.86, 0, 500, 72], [1.78, 0.192, 9.27, 0, 500, 73], [1.773, 0.231, 7.5, 0, 500, 0], [1.765, 0.273, 6.46, 0, 500, 0], [1.762, 0.315, 5.59, 0, 500, 0], [1.754, 0.358, 4.89, 0, 500, 0], [1.734, 0.399, 4.34, 0, 500, 0], [1.725, 0.439, 3.78, 0, 500, 0], [1.721, 0.48, 3.54, 0, 500, 0], [1.711, 0.521, 3.15, 0, 500, 0], [1.688, 0.561, 3.01, 0, 500, 0], [1.667, 0.602, 2.7, 0, 500, 0], [1.657, 0.636, 2.59, 0, 500, 0], [1.648, 0.678, 2.32, 0, 500, 0], [1.613, 0.718, 2.1, 0, 500, 0], [1.244, 0.761, 1.64, 0, 500, 0], [0.461, 0.793, 0.58, 0, 500, 0], [0.016, 0.798, 0.02, 0, 500, 0]]
  "X": f64
  "Y": f64
  "Stop": bool
  "error in": error
  "error in_2": error
  "error in_3": error
panel indicators:
  "Start/Stop lab": bool
  "Refresh": bool
  "Lab Manual": bool
  "Graph Voltage": f64[]
  "Clear Graph V/Measurment": bool
  "Change history V/Measurment": bool
  "Isc/Calculation": bool
  "Uoc/Calculation": bool
  "Graph Tab 4": cluster{"Element 1": f64[], "Element 2": f64[]}
  "Print Page": bool
  "Slot name": string
  "Imp/Calculation": bool
  "Ump/Calculation": bool
  "FF": f64
  "Graph 1 Tab 3": T1[]
  "Graph 2 Tab 3": cluster{"Element 1": f64[], "Element 2": f64[]}[]
  "T1/Calclation": bool
  "T2/Calculation": bool
  "Uoc1/Calculation": bool
  "Uoc2/Calculation": bool
  "Kt": f64
  "Total Load, Ohm": i32
  "URL Image_2": string
  "URL Image_3": string
  "Graph Current": f64[]
  "Clear Graph I/Measurment": bool
  "Graph Temperature": f64[]
  "Clear Graph T/Measurment": bool
  "Change History I/Measurment": bool
  "Change History T/Measurment": bool
  "URL Image_4": string
  "Memory Slot": string[]
  "Read Slot Name": string
  "URL Image_5": string
  "LED": bool
  "button_38": bool
  "Table/Measurment": f64[][]
  "URL Image_6": string
  "URL Image_7": string
  "Graph Tab 1": T1[]
  "Web Camera": string
  "Temperature, ºC": f64
  "Delete Last": bool
  "Slot name2.1": string
  "Slot name2.2": string
  "Slot name2.3": string
  "Update Display": string
  "Graph Load": f64[]
  "Clear Graph R/Measurment": bool
  "Change History R/Measurment": bool
  "Graph_10": f64[]
  "Clear Graph J/Measurment": bool
  "Change History J/Measurment_2": bool
  "Table Measurments": f64[][]
  "Headers/Calculation": string[]
  "Slot name2.4": string
  "Headers/Measurment": string[]
  "Intensity, W/m2": f64
  "Panel tilt angle, º": f64
  "Angle of rotation 1, º": f64
  "Angle of rotation 1, º_2": f64
  "Table/Avarage": f64[][]
  "Table Tab 4": f64[][]
  "Header XY": string[]
  "Table Tab 4_2": f64[][]
  "error out": error
  "error out_2": error
  "error out_3": error
  "size(s)": i32
types:
  T1 = cluster{"Element 1": cluster{"Element 1": f64, "Element 2": f64}[]}
uses:
  NI::Skyline::Configuration::Open Configuration.gvi
  NI::Skyline::TagHTTP::Query Tags.gvi
  NI::Skyline::TagHTTP::Open Tag.gvi
  NI::Skyline::TagHTTP::Read Tag (DBL).gvi
  NI::Skyline::TagHTTP::Close Tag (Single).gvi
  NI::Skyline::Configuration::Close Configuration.gvi
  NI::Skyline::TagHTTP::Write Tag (DBL).gvi
  NI::Skyline::MessageHTTP::Open.gvi
  NI::Skyline::MessageHTTP::Publish.gvi
  NI::Skyline::MessageHTTP::Flush.gvi
  NI::Skyline::MessageHTTP::Subscribe.gvi
  NI::Skyline::MessageHTTP::Read.gvi
  NI::Skyline::MessageHTTP::Unsubscribe.gvi
  WebApp::Support::Message Queue::Create All Message Queues.gvi
  WebApp::Support::Message Queue::Enqueue Message (Single).gvi
  WebApp::Support::Message Queue::Dequeue Message.gvi
  WebApp::Memory Buffer::Memory buffer.gvi
  WebApp::Custom Chart::Custom Chart.gvi
  WebApp::Load Selection::Load selection.gvi
diagram:
  while {
    Wait(time to wait=200)
    call "Open Configuration.gvi"(server url="http://localhost:80", username="admin", password="w", error in=$"error in_2") -> (configuration=w1, error out=w2)
    w3 = ["temperature indicator", "intensity indicator", "angle indicator"]
    call "Query Tags.gvi"(paths=w3, error in=w2, configuration=w1) -> (tags=w4, error out=w5)
    for {
      w6 = each element of w4
      Wait(time to wait=400)
      Property Node(instance in=w6) -> ("Path"=w8, "Datatype"=w9)
      call "Open Tag.gvi"(path=w8, data type=w9, error in=w5, configuration=w1) -> (tag=w10, error out=w11)
      call "Read Tag (DBL).gvi"(tag in=w10, error in=w11) -> (tag out=w12, value=w13, error out=w14)
      append w13 to w7
    }
    call "Close Tag (Single).gvi"(tag=w12, error in=w14) -> (error out=w15)
    call "Close Configuration.gvi"(configuration=w1, error in=w15) -> (error out=w16)
    $"error out_2" <- w16
    Array Index(array=w7) -> (out0[_]=w17, out1[_]=w18, out2[_]=w19)
    $"Panel tilt angle, º" <- w17
    $"Intensity, W/m2" <- w18
    $"Temperature, ºC" <- w19
    Array Size(array=w7) -> (size(s)=w20)
    $"size(s)" <- w20
    call "Open Configuration.gvi"(server url="http://localhost:80", username="admin", password="w", error in=$"error in_3") -> (configuration=w21, error out=w22)
    call "Query Tags.gvi"(paths=["angle control", "light control", ""], error in=w22, configuration=w21) -> (tags=w23, error out=w24)
    Build Array($"Solar panel tilt angle, º", $"Power setting for the light source, W") -> w25
    for {
      w26 = each element of w23
      w27 = each element of w25
      Wait(time to wait=400)
      Property Node(instance in=w26) -> ("Path"=w28, "Datatype"=w29)
      call "Open Tag.gvi"(path=w28, data type=w29, error in=w24, configuration=w21) -> (tag=w30, error out=w31)
      call "Write Tag (DBL).gvi"(tag in=w30, value=w27, error in=w31) -> (tag out=w32, error out=w33)
    }
    call "Close Tag (Single).gvi"(tag=w32, error in=w33) -> (error out=w34)
    call "Close Configuration.gvi"(configuration=w21, error in=w34) -> (error out=w35)
    $"error out_3" <- w35
    stop if FALSE
  }
  sequence {
    frame 0 {
      call "Open Configuration.gvi"(server url="http://localhost:80/", username="admin", password="password") -> (configuration=w36, error out=w37)
      call "Open.gvi"(error in=w37, configuration=w36) -> (message session=w38, error out=w39)
    }
    frame 1 {
      s1 = w38  # shift register
      s2 = w39  # shift register
      while {
        call "Publish.gvi"(message session in=s1, topic="TopicName", message="New Message\n..................\n..................", error in=s2) -> (message session out=w40, error out=w41)
        next s1 = w40
        next s2 = w41
        stop if FALSE
      }
    }
    frame 2 {
      call "Flush.gvi"(message session in=s1, error in=s2) -> (error out=w42)
      call "Close Configuration.gvi"(configuration=w36, error in=w42)
    }
  }
  sequence {
    frame 0 {
      call "Open Configuration.gvi"(server url="http://localhost:80/", username="admin", password="password") -> (configuration=w43, error out=w44)
      call "Open.gvi"(error in=w44, configuration=w43) -> (message session=w45, error out=w46)
    }
    frame 1 {
      call "Subscribe.gvi"(message session in=w45, topic="TopicName", error in=w46) -> (message session out=w47, error out=w48)
    }
    frame 2 {
      s3 = w47  # shift register
      s4 = w48  # shift register
      while {
        call "Read.gvi"(message session in=s3, error in=s4) -> (message session out=w49, topic=w50, message=w51, error out=w52)
        sequence (after w50) (after w51) {
          frame 0 { }
        }
        next s3 = w49
        next s4 = w52
        stop if FALSE
      }
    }
    frame 3 {
      call "Unsubscribe.gvi"(message session in=s3, topic="TopicName", error in=s4) -> (message session out=w53, error out=w54)
    }
    frame 4 {
      call "Flush.gvi"(message session in=w53, error in=w54) -> (error out=w55)
      call "Close Configuration.gvi"(configuration=w43, error in=w55)
    }
  }
  call "Create All Message Queues.gvi"() -> (message queue=w56, error out=w57)
  while {
    event {
      on "Save in memory" Value changed {
        w58 = "Measurements/Save in Memory Buffer"  # Buttons WebVI
        call "Enqueue Message (Single).gvi"(message queue in=w56, message="", Enum=w58)
      }
      on "Slot number/Read/" Value changed {
        w59 = "Measurements/Read from Memory Buffer"  # Buttons WebVI
        call "Enqueue Message (Single).gvi"(message queue in=w56, message="", Enum=w59)
      }
      on "Clear Memory" Value changed {
        w60 = "Memory Buffer/Clear"  # Buttons WebVI
        call "Enqueue Message (Single).gvi"(message queue in=w56, message="", Enum=w60)
      }
      on "Clear All Memory" Value changed {
        w61 = "Memory Buffer/Clear all"  # Buttons WebVI
        call "Enqueue Message (Single).gvi"(message queue in=w56, message="", Enum=w61)
      }
      on "1000х" Value changed; "100х" Value changed; "10х" Value changed; "1х, Ohm" Value changed; "Manual/Automatic" Value changed {
        w62 = "Load Selection"  # Buttons WebVI/Measurments
        call "Enqueue Message (Single).gvi"(message queue in=w56, message="", Enum=w62)
      }
      on "Set Load" Value changed { }
      on "Slot number Tab 1" Value changed {
        w63 = "Calculations/Read Slot Memory"  # Buttons WebVI/Measurments
        call "Enqueue Message (Single).gvi"(message queue in=w56, message="", Enum=w63)
      }
      on "Calculate Tab 1" Value changed {
        w64 = "Calculation/Tab 1"  # Buttons WebVI/Measurments
        call "Enqueue Message (Single).gvi"(message queue in=w56, message="", Enum=w64)
      }
      on "Clear/ Tab 1" Value changed {
        w65 = "Clear/Tab 1"  # Buttons WebVI/Measurments
        call "Enqueue Message (Single).gvi"(message queue in=w56, message="", Enum=w65)
      }
      on "Calc/Slot number2.1" Value changed; "Calc/Slot number2.2" Value changed; "Calc/Slot number2.3" Value changed; "Calc/Slot number2.4" Value changed; "Show / Hide Graph 1" Value changed; "Show / Hide Graph 2" Value changed; "Show / Hide Graph 3" Value changed; "Show / Hide Graph 4" Value changed {
        w66 = "Calculation/Tab 2"  # Buttons WebVI/Measurments
        call "Enqueue Message (Single).gvi"(message queue in=w56, message="", Enum=w66)
      }
      on "Add to table Tab 4" Value changed {
        w67 = "Create Table/Tab 3"  # Buttons WebVI
        call "Enqueue Message (Single).gvi"(message queue in=w56, message="", Enum=w67)
      }
      on "Clear Table Tab 4" Value changed {
        w68 = "Clear Table/Tab 3"  # Buttons WebVI
        call "Enqueue Message (Single).gvi"(message queue in=w56, message="", Enum=w68)
      }
      on "Delete Last Tab 4" Value changed {
        w69 = "Delete Last Table/Tab 3"  # Buttons WebVI
        call "Enqueue Message (Single).gvi"(message queue in=w56, message="", Enum=w69)
      }
      on "Show Graph Tab 4" Value changed {
        call "Enqueue Message (Single).gvi"(message queue in=w56, message="", Enum="Show Chart")
      }
      on "Clear Graph Tab 4" Value changed {
        w70 = "Clear Chart"  # Buttons WebVI
        call "Enqueue Message (Single).gvi"(message queue in=w56, message="", Enum=w70)
      }
      on "Parameter X" Value changed; "Parameter Y" Value changed {
        w71 = "Header Tab 3"  # Buttons WebVI
        call "Enqueue Message (Single).gvi"(message queue in=w56, message="", Enum=w71)
      }
    }
    stop if FALSE
  }
  call "Open Configuration.gvi"(server url="", username="admin", password="test", error in=$"error in") -> (configuration=w72, error out=w73)
  call "Open Tag.gvi"(path="", data type="Double", error in=w73, configuration=w72) -> (tag=w74, error out=w75)
  while {
    call "Write Tag (DBL).gvi"(tag in=w74, value=0, error in=w75) -> (tag out=w76, error out=w77)
    stop if $Stop
  }
  call "Close Tag (Single).gvi"(tag=w76, error in=w77) -> (error out=w78)
  call "Close Configuration.gvi"(configuration=w72, error in=w78) -> (error out=w79)
  $"error out" <- w79
  while {
    call "Dequeue Message.gvi"(message queue in=w56, error in=w57) -> (message queue out=w80, message=w81, Enum=w82)
    case (w82) {
      frame "Initialize ", Default {
        call "Memory buffer.gvi"(Initialize/Max Number of slots memory=10, Command to buffer="Initialize") -> (Slot name indicator=w83)
        $"Memory Slot" <- w83
        w84 = "Initialize"  # Command Chart
        call "Custom Chart.gvi"(Command Graph=w84, X=0, Y=0) -> (Table out=w85, Chart=w86)
        $"Table Tab 4" <- w85
        Property Node(instance in=reference to "Slot number Tab 1", "Value"=10)
        $"Graph Tab 4" <- w86
        Property Node(instance in=reference to "Table/Measurment", "Value"=f64[][] [])
        Property Node(instance in=reference to "Slot name", "Value"="")
        Property Node(instance in=reference to "Graph Tab 1", "Value"=T1[] [])
        w87 = ["U, V", "I, A", "R, Ohm", "Angle, º", "J, W / m²", "T, ºC", "P,W", "ɳ,%"]
        $"Headers/Measurment" <- w87
        $"Headers/Calculation" <- w87
        Property Node(instance in=reference to "Table Measurments", "Value"=f64[][] [])
        w88 = "Update Display"  # Buttons WebVI
        call "Enqueue Message (Single).gvi"(message queue in=w80, message="Initialize", Enum=w88)
      }
      frame "Measurements/Save in Memory Buffer" {
        call "Memory buffer.gvi"(Number of slot=$"Slot Number", Command to buffer="Read") -> (Read/Slot=w89)
        Property Node(instance in=w89, "Slot name"=$"Slot Name", "Measurements"=$"Input Data") -> (instance out=w90)
        w91 = "Write"  # Command
        call "Memory buffer.gvi"(Buffer Data=w90, Number of slot=$"Slot Number", Command to buffer=w91) -> (Slot name indicator=w92, Read/Slot=w93)
        $"Memory Slot" <- w92
        Property Node(instance in=w93) -> ("Measurements"=w94)
        $"Table/Measurment" <- w94
        w95 = "Update Display"  # Buttons WebVI
        call "Enqueue Message (Single).gvi"(message queue in=w80, message="Data recording", Enum=w95)
      }
      frame "Measurements/Read from Memory Buffer" {
        w96 = "Read"  # Command
        call "Memory buffer.gvi"(Number of slot=$"Slot number/Read/", Command to buffer=w96) -> (Slot name indicator=w97, Read/Slot=w98)
        $"Memory Slot" <- w97
        Property Node(instance in=w98) -> ("Slot name"=w99, "Measurements"=w100)
        $"Read Slot Name" <- w99
        $"Table/Measurment" <- w100
        w101 = "Update Display"  # Buttons WebVI
        call "Enqueue Message (Single).gvi"(message queue in=w80, message="Reading From Memory Buffer", Enum=w101)
      }
      frame "Memory Buffer/Clear" {
        w102 = "Clear"  # Command
        call "Memory buffer.gvi"(Number of slot=$"Slot number/Read/", Command to buffer=w102) -> (Slot name indicator=w103, Read/Slot=w104)
        $"Memory Slot" <- w103
        Property Node(instance in=w104) -> ("Slot name"=w105, "Measurements"=w106)
        $"Read Slot Name" <- w105
        $"Table/Measurment" <- w106
        w107 = "Update Display"  # Buttons WebVI
        call "Enqueue Message (Single).gvi"(message queue in=w80, message="Deleting memory", Enum=w107)
      }
      frame "Memory Buffer/Clear all" {
        w108 = "Clear all"  # Command
        call "Memory buffer.gvi"(Number of slot=$"Slot number/Read/", Command to buffer=w108) -> (Slot name indicator=w109, Read/Slot=w110)
        $"Memory Slot" <- w109
        Property Node(instance in=w110) -> ("Slot name"=w111, "Measurements"=w112)
        $"Read Slot Name" <- w111
        $"Table/Measurment" <- w112
        w113 = "Update Display"  # Buttons WebVI
        call "Enqueue Message (Single).gvi"(message queue in=w80, message="Deleting all memory", Enum=w113)
      }
      frame "Load Selection" {
        case ($"Manual/Automatic") {
          frame "Manual", Default {
            Property Node(instance in=reference to "1000х", "Disabled"=FALSE)
            Property Node(instance in=reference to "100х", "Disabled"=FALSE)
            call "Load selection.gvi"(List box=reference to "100х", Value=[100, 200, 400, 500]) -> (Sum=w114)
            Property Node(instance in=reference to "10х", "Disabled"=FALSE) -> (instance out=w115)
            call "Load selection.gvi"(List box=w115, Value=[10, 20, 40, 50]) -> (Sum=w116)
            call "Load selection.gvi"(List box=reference to "1х, Ohm", Value=[1, 2, 4, 5]) -> (Sum=w117)
            call "Load selection.gvi"(List box=reference to "1000х", Value=[1000, 2000, 3000]) -> (Sum=w118)
            Add(w118, w114, w116, w117) -> w119
            $"Total Load, Ohm" <- w119
            Property Node(instance in=reference to "Set Load", "Disabled"=FALSE)
            Property Node(instance in=reference to "1х, Ohm", "Disabled"=FALSE)
            Property Node(instance in=reference to "Total Load, Ohm", "Disabled"=FALSE)
          }
          frame "Automatic" {
            Property Node(instance in=reference to "1000х", "Disabled"=TRUE)
            Property Node(instance in=reference to "100х", "Disabled"=TRUE)
            Property Node(instance in=reference to "10х", "Disabled"=TRUE)
            Property Node(instance in=reference to "Set Load", "Disabled"=TRUE)
            Property Node(instance in=reference to "1х, Ohm", "Disabled"=TRUE)
            Property Node(instance in=reference to "Total Load, Ohm", "Disabled"=TRUE)
          }
        }
        w120 = "Update Display"  # Buttons WebVI
        call "Enqueue Message (Single).gvi"(message queue in=w80, message="Load selection", Enum=w120)
      }
      frame "Set Load" { }
      frame "Calculations/Read Slot Memory" {
        w121 = "Read"  # Command
        call "Memory buffer.gvi"(Number of slot=$"Slot number Tab 1", Command to buffer=w121) -> (Read/Slot=w122)
        Property Node(instance in=w122) -> ("Slot name"=w123, "Measurements"=w124)
        $"Slot name" <- w123
        $"Table Measurments" <- w124
        w125 = "Update Display"  # Buttons WebVI
        call "Enqueue Message (Single).gvi"(message queue in=w80, message="Buffer memory-Tab1", Enum=w125)
      }
      frame "Calculation/Tab 1" {
        w126 = "Read"  # Command
        call "Memory buffer.gvi"(Number of slot=$"Slot number Tab 1", Command to buffer=w126) -> (Read/Slot=w127)
        Property Node(instance in=w127) -> ("Measurements"=w128)
        Array Index(array=w128) -> (out0[_, 0]=w129, out1[_, 1]=w130, out2[_, 4]=w131)
        Build Index And Bundle Cluster Array(w129, w130) -> (out=w132)
        Multiply(w129, w130) -> w133
        Build Index And Bundle Cluster Array(w129, w133) -> (out=w134)
        Build Cluster Array(w132, w134) -> (out=w135)
        $"Graph Tab 1" <- w135
        w136 = "Write"  # Command
        w137 = "Read"  # Command
        call "Memory buffer.gvi"(Number of slot=$"Slot number Tab 1", Command to buffer=w137) -> (Read/Slot=w138)
        w139 = 0.025  # Square Solar Panel
        Multiply(w131, w139) -> w140
        Divide(x=w133, y=w140) -> w141
        Multiply(w141, 100) -> w142
        Build Array(w133, w142) -> w143
        Transpose 2D Array(2D array=w143) -> (transposed array=w144)
        Property Node(instance in=w138, "Calculations "=w144) -> (instance out=w145)
        call "Memory buffer.gvi"(Buffer Data=w145, Number of slot=$"Slot number Tab 1", Command to buffer=w136) -> (Read/Slot=w146)
        call "Memory buffer.gvi"(Buffer Data=w146, Number of slot=$"Slot number Tab 1", Command to buffer="Read") -> (Read/Slot=w147)
        Property Node(instance in=w147) -> ("Measurements"=w148, "Calculations "=w149)
        Insert Into Array(inArray=w148, index1=6, new=w149) -> w150
        $"Table Measurments" <- w150
        w151 = "Update Display"  # Buttons WebVI
        call "Enqueue Message (Single).gvi"(message queue in=w80, message="Calculate Tab 1", Enum=w151)
      }
      frame "Clear/Tab 1" {
        Property Node(instance in=reference to "Graph Tab 1", "Value"=T1[] [])
        Property Node(instance in=reference to "Table Measurments", "Value"=f64[][] [])
        w152 = "Update Display"  # Buttons WebVI
        call "Enqueue Message (Single).gvi"(message queue in=w80, message="Clear Graph Tab 1", Enum=w152)
      }
      frame "Calculation/Tab 2" {
        Build Array($"Calc/Slot number2.1", $"Calc/Slot number2.2", $"Calc/Slot number2.3", $"Calc/Slot number2.4") -> w153
        Build Array($"Show / Hide Graph 1", $"Show / Hide Graph 2", $"Show / Hide Graph 3", $"Show / Hide Graph 4") -> w154
        for {
          w155 = each element of w154
          w156 = each element of w153
          case (w155) {
            frame False, Default {
              w163 = cluster{"Element 1": f64[], "Element 2": f64[]} {all zero or empty}
              w160 = default
              w161 = T1[] []
              w162 = w163
            }
            frame True {
              w164 = "Read"  # Command
              call "Memory buffer.gvi"(Number of slot=w156, Command to buffer=w164) -> (Read/Slot=w165)
              Property Node(instance in=w165) -> (instance out=w166)
              Property Node(instance in=w166) -> ("Measurements"=w167, "Calculations "=w168, "Slot name"=w160)
              Array Index(array=w167) -> (out0[_, 0]=w169, out1[_, 1]=w170, out2[_, 2]=w171)
              Build Index And Bundle Cluster Array(w169, w170) -> (out=w172)
              Array Index(array=w168) -> (out0[_, 0]=w173, out1[_, 1]=w174)
              Build Index And Bundle Cluster Array(w169, w173) -> (out=w175)
              Build Cluster Array(w172, w175) -> (out=w161)
              Build Cluster(w171, w174) -> w162
            }
          }
          append w160 to w157
          concatenate w161 onto w158
          append w162 to w159
        }
        $"Graph 1 Tab 3" <- w158
        Array Index(array=w157) -> (out0[_]=w176, out1[_]=w177, out2[_]=w178, out3[_]=w179)
        $"Slot name2.1" <- w176
        $"Slot name2.2" <- w177
        $"Slot name2.3" <- w178
        $"Slot name2.4" <- w179
        $"Graph 2 Tab 3" <- w159
        w180 = "Update Display"  # Buttons WebVI
        call "Enqueue Message (Single).gvi"(message queue in=w80, message="Calculation Tab 2", Enum=w180)
      }
      frame "Header Tab 3" {
        Property Node(instance in=reference to "Parameter X") -> ("Items"=w181, "Value"=w182)
        Array Index(array=w181) -> (out0[w182]=w183)
        Property Node(instance in=reference to "Parameter Y") -> ("Items"=w184, "Value"=w185)
        Array Index(array=w184) -> (out0[w185]=w186)
        Build Array(w183, w186) -> w187
        $"Header XY" <- w187
      }
      frame "Create Table/Tab 3" {
        w188 = "Write/Read "  # Command Chart
        call "Custom Chart.gvi"(Command Graph=w188, X=$X, Y=$Y) -> (Table out=w189)
        $"Table Tab 4" <- w189
        w190 = "Update Display"  # Buttons WebVI
        call "Enqueue Message (Single).gvi"(message queue in=w80, message="Crate Table Tab 3", Enum=w190)
      }
      frame "Clear Table/Tab 3" {
        w191 = "Clear Table"  # Command Chart
        call "Custom Chart.gvi"(Command Graph=w191, X=$X, Y=$Y) -> (Table out=w192)
        $"Table Tab 4_2" <- w192
      }
      frame "Delete Last Table/Tab 3" {
        w193 = "Delete last"  # Command Chart
        call "Custom Chart.gvi"(Command Graph=w193, X=$X, Y=$Y) -> (Table out=w194)
        $"Table Tab 4" <- w194
      }
      frame "Show Chart" {
        call "Custom Chart.gvi"(Command Graph="Graph", X=$X, Y=$Y) -> (Chart=w195)
        $"Graph Tab 4" <- w195
      }
      frame "Clear Chart" {
        w196 = "Clear Chart"  # Command Chart
        call "Custom Chart.gvi"(Command Graph=w196, X=$X, Y=$Y) -> (Chart=w197)
        $"Graph Tab 4" <- w197
      }
      frame "Update Display" {
        $"Update Display" <- w81
      }
    }
    stop if FALSE
  }
